# Grasshopper definition facade_panelizer.gh (Grasshopper 1.0.8)

U = Slider(7, range=1..50)
V = Slider(10, range=1..50)
py3 = Python3Script(Prefix="P", U=U, V=V)  # -> out, Panels, IDs, Errors
# ---------- py3: Python ----------
import os
import sys
import traceback

try:
    repo = os.getenv("GH_PARAMETRIC_TOOLKIT")
    if repo and repo not in sys.path:
        sys.path.insert(0, repo)

    from shared.loader import ensure_repo_on_syspath, run_tool
    ensure_repo_on_syspath()

    def main():
        from tools.facade_panelizer.src.panelizer import generate_panel_ids

        u = int(U)
        v = int(V)
        prefix = Prefix or "P"

        return generate_panel_ids(u, v, prefix)

    Result, Errors = run_tool(main)

except Exception:
    Errors = [traceback.format_exc()]
# ---------- end py3 ----------
panel = Panel(py3.Errors)
panel_2 = Panel(py3.Panels)
panel_3 = Panel(py3.IDs)
